# Grasshopper definition 180530_vivetracking_0.gh (Grasshopper 0.9.76)
# plug-ins: MeshEdit Components, Firefly.X, AstarPathFinder, gHowl

number_slider = Slider(123.7, range=0..360)  # disabled
number_slider_2 = Slider(0, range=0..360)  # disabled
number_slider_3 = Slider(258.8, range=0..360)  # disabled
radians = Radians(Degrees=number_slider)  # disabled
radians_2 = Radians(Degrees=number_slider_2)  # disabled
radians_3 = Radians(Degrees=number_slider_3)  # disabled
construct_point = ConstructPoint(XCoordinate=0, YCoordinate=0, ZCoordinate=0)  # disabled
xy_plane = XYPlane(Origin=Point(0, 0, 0))  # disabled
yz_plane = YZPlane(Origin=Point(0, 0, 0))  # disabled
xz_plane = XZPlane(Origin=Point(0, 0, 0))  # disabled
timer = Timer(TimerInterval=20)  # disabled
panel = Panel(",")  # disabled
text_split = TextSplit(Separators=panel)  # disabled
list_item = ListItem(List=text_split, Index=0, Wrap=True)  # -> Item, Item1, Item2, Item3, Item4, Item5, Item6; disabled
createquaternionfromxyzw = CreateQuaternionFromXYZW(X=list_item.Item3, Y=list_item.Item5, Z=list_item.Item4, W=list_item.Item6)  # disabled
construct_point_2 = ConstructPoint(XCoordinate=list_item.Item, YCoordinate=list_item.Item2, ZCoordinate=list_item.Item1)  # disabled
number_slider_4 = Slider(19, range=0..100)  # disabled
creatematrixfromquaternion = CreateMatrixFromQuaternion(Quaternion=createquaternionfromxyzw)  # disabled
multiplication = Multiplication(A=construct_point_2, B=number_slider_4)  # disabled
matrixdecompose = MatrixDecompose()  # -> Scale, Rotation, Translation; disabled
data_recorder = DataRecorder(multiplication, DataLimit=200, RecordData=True)  # disabled
list_length = ListLength(List=data_recorder)  # disabled
series = Series(Start=0, Step=1, Count=list_length)  # disabled
division = Division(A=series, B=list_length)  # disabled
number_slider_5 = Slider(0.44, range=0..1)  # disabled
gradient = Gradient(LowerLimit=0, UpperLimit=1, Parameter=division, stops=[0: RGB(255, 255, 255), 1: RGB(0, 0, 0)])  # disabled
transform = Transform(Transform=creatematrixfromquaternion)  # disabled
custom_preview = CustomPreview(
    Geometry=transform,
    Shader={ambient=RGB(0, 0, 0), diffuse=RGB(255, 105, 180), emission=RGB(76, 32, 54), shine=0.5, specular=RGB(255, 255, 255), transparency=0})  # disabled
custom_preview_2 = CustomPreview(Geometry=data_recorder, Shader=gradient)  # disabled
dot_display = DotDisplay(Colour=gradient, Size=number_slider_5)  # disabled
radians_4 = Radians(Degrees=Slider(141.7, range=0..360))
radians_5 = Radians(Degrees=Slider(0, range=0..360))
radians_6 = Radians(Degrees=Slider(258.8, range=0..360))
xy_plane_2 = XYPlane(Origin=Point(0, 0, 0))
network_source = NetworkSource()  # -> NetworkAdapterIsUp, AdapterProperties, LocalIpAddress
yz_plane_2 = YZPlane(Origin=Point(0, 0, 0))
xz_plane_2 = XZPlane(Origin=Point(0, 0, 0))
udp_listener = UDPListener(Port="8051")
timer_2 = Timer(TimerInterval=50, Target=udp_listener)
data_recorder_2 = DataRecorder(udp_listener, DataLimit=30, RecordData=True)
panel_2 = Panel(udp_listener)
text_split_2 = TextSplit(Text=data_recorder_2, Separators=",")
panel_3 = Panel(text_split_2)
list_item_2 = ListItem(List=text_split_2, Index=0, Wrap=True)  # -> Item, Item1, Item2, Item3, Item4, Item5, Item6
construct_point_3 = ConstructPoint(XCoordinate=list_item_2.Item, YCoordinate=list_item_2.Item2, ZCoordinate=list_item_2.Item1)  # -> flatten(Point)
createquaternionfromxyzw_2 = CreateQuaternionFromXYZW(X=list_item_2.Item3, Y=list_item_2.Item5, Z=list_item_2.Item4, W=list_item_2.Item6)  # -> flatten(Quaternion)
creatematrixfromquaternion_2 = CreateMatrixFromQuaternion(Quaternion=createquaternionfromxyzw_2)
multiplication_2 = Multiplication(A=construct_point_3, B=Slider(65, range=0..100))
data_dam = DataDam(DataA=multiplication_2, BufferDelay=20000000, BufferMode=2)
matrixdecompose_2 = MatrixDecompose(Matrix=creatematrixfromquaternion_2)  # -> Scale, Rotation, Translation
list_length_2 = ListLength(List=data_dam)
panel_4 = Panel(matrixdecompose_2.Rotation)
rotate_3d = Rotate3D(Angle=1.570796327, Center=Point(0, 0, 0), Axis=Vector(0, 0, 1))  # -> Geometry, Transform
series_2 = Series(Start=0, Step=1, Count=list_length_2)
division_2 = Division(A=series_2, B=list_length_2)
gradient_2 = Gradient(LowerLimit=0, UpperLimit=1, Parameter=division_2, stops=[0: RGB(255, 255, 255), 1: RGB(0, 0, 0)])
transform_2 = Transform()
panel_5 = Panel(multiplication_2)

# ---- group: geo to center
geometry = Geometry(<mesh referenced from the Rhino model>)  # disabled
construct_point_4 = ConstructPoint(XCoordinate=0, YCoordinate=0, ZCoordinate=0)  # disabled

# ----
rotate = Rotate(Geometry=geometry, Angle=radians, Plane=xy_plane)  # -> Geometry, Transform; disabled
rotate_2 = Rotate(Geometry=rotate.Geometry, Angle=radians_2, Plane=yz_plane)  # -> Geometry, Transform; disabled
rotate_3 = Rotate(Geometry=rotate_2.Geometry, Angle=radians_3, Plane=xz_plane)  # -> Geometry, Transform; disabled
geometry_2 = Geometry(rotate_3.Geometry)  # disabled

# ---- group: geo to center (continued)
mesh_volume = MeshVolume(Mesh=geometry_2)  # -> Volume, Centroid; disabled
vector_2pt = Vector2Pt(PointA=mesh_volume.Centroid, PointB=construct_point_4, Unitize=False)  # -> Vector, Length; disabled
move = Move(Geometry=geometry_2, Motion=vector_2pt.Vector)  # -> Geometry, Transform; disabled

# ----
move_2 = Move(Geometry=[transform, move.Geometry], Motion=data_recorder)  # -> Geometry, Transform; disabled

# ---- group: geo to center
geometry_3 = Geometry(<mesh referenced from the Rhino model>)
construct_point_5 = ConstructPoint(XCoordinate=0, YCoordinate=0, ZCoordinate=0)

# ----
rotate_4 = Rotate(Geometry=geometry_3, Angle=radians_4, Plane=xy_plane_2)  # -> Geometry, Transform
rotate_5 = Rotate(Geometry=rotate_4.Geometry, Angle=radians_5, Plane=yz_plane_2)  # -> Geometry, Transform
rotate_6 = Rotate(Geometry=rotate_5.Geometry, Angle=radians_6, Plane=xz_plane_2)  # -> Geometry, Transform
geometry_4 = Geometry(rotate_6.Geometry)

# ---- group: geo to center (continued)
mesh_volume_2 = MeshVolume(Mesh=geometry_4)  # -> Volume, Centroid
vector_2pt_2 = Vector2Pt(PointA=mesh_volume_2.Centroid, PointB=construct_point_5, Unitize=False)  # -> Vector, Length
move_3 = Move(Geometry=geometry_4, Motion=vector_2pt_2.Vector)  # -> Geometry, Transform

# ----
transform_3 = Transform(Geometry=move_3.Geometry, Transform=creatematrixfromquaternion_2)
list_item_3 = ListItem(List=reverse(transform_3), Index=0, Wrap=True)
move_4 = Move(Geometry=transform_3, Motion=multiplication_2)  # -> Geometry, Transform
custom_preview_3 = CustomPreview(
    Geometry=list_item_3,
    Shader={ambient=RGB(0, 0, 0), diffuse=RGB(255, 105, 180), emission=RGB(76, 32, 54), shine=0.5, specular=RGB(255, 255, 255), transparency=0})
custom_preview_4 = CustomPreview(Geometry=move_4.Geometry, Shader=gradient_2)
