# Grasshopper definition pointbot_gh.ghx (Grasshopper 0.9.76)
# plug-ins: Firefly.X, Human, gHowl, Telepathy

input_curve = Geometry(<curve referenced from the Rhino model>)

divlength = DivideLength(Curve=input_curve, Length=Slider(9, range=0..100))  # -> Points, Tangents, Parameters
use_optimized = BooleanToggle(True)
geo = Geometry(input_curve)
# the land of curve optimization
number_slider = Slider(37, range=0..100)
divlength_2 = DivideLength(Curve=geo, Length=Slider(6, range=0..10))  # -> Points, Tangents, Parameters
curvature = Curvature(Curve=geo, Parameter=divlength_2.Parameters)  # -> P, K, C
item = ListItem(List=divlength_2.Points, Index=number_slider, Wrap=True)
vlen = VectorLength(Vector=curvature.K)
item_2 = ListItem(List=vlen, Index=number_slider, Wrap=True)
vdis = VectorDisplay(Anchor=curvature.P, Vector=curvature.K)
median = Median(K=vlen)
smaller = SmallerThan(FirstNumber=vlen, SecondNumber=median)  # -> SmallerThan, OrEqualTo
avr = Average(Input=vlen)
panel = Panel(median)
dispatch = Dispatch(List=divlength_2.Points, DispatchPattern=smaller.SmallerThan)  # -> ListA, ListB
end = EndPoints(Curve=geo)  # -> Start, End
geo_2 = Geometry(dispatch.ListB)
panel_3 = Panel(avr)
geo_3 = Geometry(<brep referenced from the Rhino model>)
geothatsymbolizestracker = RemoteSender(geo_3)
merge = Merge(Data1=flatten(end.Start), Data2=flatten(geo_2), Data3=flatten(end.End))
# the hill of simulating movement
number_slider_2 = Slider(31, range=0..31)

# ---- group: significant digits
number_slider_3 = Slider(2, range=0..10)

# ----
geothatsymbolizestracker_2 = RemoteReceiver(geothatsymbolizestracker)
division = Division(A=number_slider_2, B="31")
Y = UnitY(Factor=1)
volume = Volume(Geometry=geothatsymbolizestracker_2)  # -> Volume, Centroid
geo_4 = Geometry(merge)
geo_5 = Geometry(geo_4)
filter = StreamFilter(Gate=use_optimized, Stream0=divlength.Points, Stream1=geo_5)

# ---- group: List of Points
geo_6 = Geometry(filter)

# ---- group: movement & angle calc
shift = ShiftList(List=geo_6, Shift=1, Wrap=False)
short = ShortestList(ListA=geo_6, ListB=shift, TrimMode=2)  # -> ListA, ListB
vec2pt = Vector2Pt(PointA=short.ListA, PointB=short.ListB, Unitize=False)  # -> Vector, Length
dist = Distance(PointA=short.ListA, PointB=short.ListB)
# the mountain of
# decomposing movement into a list of instructions
vdis_2 = VectorDisplay(Anchor=short.ListA, Vector=vec2pt.Vector)
X = UnitX(Factor=1)
angle = Angle(VectorA=vec2pt.Vector, VectorB=X)  # -> Angle, Reflex
deg = Degrees(Radians=angle.Angle)
sigfig_rounding = SigFigRounding(A=deg, x=number_slider_3)
sigfig_rounding_2 = SigFigRounding_2(A=dist, x=number_slider_3)

# ----
pline = PolyLine(Vertices=filter, Closed=False)
eval = EvaluateLength(Curve=pline, Length=division, Normalized=True)  # -> Point, Tangent, Parameter
orient = OrientDirection(Geometry=geothatsymbolizestracker_2, PointA=volume.Centroid, DirectionA=Y, PointB=eval.Point, DirectionB=eval.Tangent)  # -> Geometry, Transform
list_of_degrees = Panel(sigfig_rounding)
previewlw = CustomPreviewLineweights(
    Geometry=pline,
    Shader={ambient=RGB(0, 0, 0), diffuse=RGB(255, 105, 180), emission=RGB(76, 32, 54), shine=0.5, specular=RGB(255, 255, 255), transparency=0},
    Thickness=Slider(3, range=0..10),
    Absolute=False)
list_of_distances = Panel(sigfig_rounding_2)
expression = Expression(x=list_of_degrees, Expression="Format(\"R {0}\", x)")
expression_2 = Expression(x=list_of_distances, Expression="Format(\"M {0}\", x)")
weave = Weave(Pattern=[0, 1], Stream0=expression, Stream1=expression_2, NullGaps=False)

tracker_broadcast_port = Panel("8053")
# NETWORK INFO
bot_sends_on_port = Panel("8052")
bot_listens_on_port = Panel("8051")
bot_ip_add = Panel("192.168.1.147")
tracker_broadcast_port_2 = RemoteSender(tracker_broadcast_port)
botlistensonport = RemoteSender(bot_listens_on_port)
botip = RemoteSender(bot_ip_add)
botsendsonport = RemoteSender(bot_sends_on_port)

interwoven_instructions = Panel(weave)
# the isle of udp receiving
# (TRACKER LOCATION)
tracker_broadcast_port_3 = RemoteReceiver(tracker_broadcast_port_2)
tracker_broadcast_port_4 = Panel(tracker_broadcast_port_3)
netsource = NetworkSource()  # -> NetworkAdapterIsUp, AdapterProperties, LocalIpAddress
panel_4 = Panel("""M 20
R 40.333
M 30.43""")
udp = UDPReceiver(Address=netsource.LocalIpAddress, Port=tracker_broadcast_port_4, Pattern=0)  # -> Info, Data
use_test_data = BooleanToggle(True)
number_slider_4 = Slider(22, range=0..100)
split = TextSplit(Text=udp.Data, Separators="|")
filter_2 = StreamFilter(Gate=use_test_data, Stream0=interwoven_instructions, Stream1=panel_4)
# recv ready from bot
timer = Timer(TimerInterval=1000, Target=counter)
# the island of udp sending
number_slider_5 = Slider(1, range=0..1)
botlistensonport_2 = RemoteReceiver(botlistensonport)
counter = Counter(CountDirection=True, Step=1, StartStop=True, Reset=False)
botip_2 = RemoteReceiver(botip)
deviceip = Panel(botip_2)
sending_port = Panel(botlistensonport_2)
item_3 = ListItem(List=filter_2, Index=counter, Wrap=True)
botsendsonport_2 = RemoteReceiver(botsendsonport)
botlistensonport_3 = RemoteReceiver(botlistensonport)
netsource_2 = NetworkSource()  # -> NetworkAdapterIsUp, AdapterProperties, LocalIpAddress
botip_3 = RemoteReceiver(botip)
filter_3 = StreamFilter(Gate=Toggle(False), Stream1=item_3)
deviceip_2 = Panel(botip_3)
sending_port_2 = Panel(botlistensonport_3)
udp_2 = UDPReceiver(Address=netsource_2.LocalIpAddress, Port=botsendsonport_2, Pattern=0)  # -> Info, Data
item_4 = ListItem(List=filter_2, Index=number_slider_5, Wrap=True)  # disabled
udp_3 = UDPSender(Address=deviceip, Port=sending_port, Pattern=0, Data=filter_3)  # disabled
panel_5 = Panel(filter_3)
table_geo = Geometry(<curve referenced from the Rhino model>)
panel_6 = Panel(udp_2.Data)
idealtablegeometry = RemoteSender(table_geo)
udp_4 = UDPSender(Address=deviceip_2, Port=sending_port_2, Pattern=0, Data=item_4)  # disabled
counter_2 = Counter(CountDirection=True, Step=1, StartStop=Button(), Reset=False)
# next step
dam = DataDam(DataA=udp_2.Data, BufferDelay=2500000, BufferMode=2)
mod = Modulus(A=counter_2, B="5")
subtraction = Subtraction(A="5", B=1)
counter_3 = Counter(CountDirection=True, Step=1, StartStop=dam, Reset=Button())
panel_7 = Panel(counter_3)
equals = Equality(FirstNumber=mod, SecondNumber=subtraction)  # -> Equality, Inequality
item_5 = ListItem(List=filter_2, Index=counter_3, Wrap=True)
filter_4 = StreamFilter(Gate=equals.Inequality, Stream1=mod)
# THE MESA OF CALIBRATION  ROUTINES
idealtablegeometry_2 = RemoteReceiver(idealtablegeometry)
xy = XYPlane(Origin=Point(0, 0, 0))
panel_8 = Panel("""calibration!
move tracker to:""")
panel_9 = Panel("""LOWER RIGHT
LOWER LEFT
UPPER LEFT
UPPER RIGHT""")
# THE HILLS OF NOT TRACKING WARNINGS
number_slider_6 = Slider(79, range=-50..150)
number_slider_7 = Slider(51, range=-50..150)
bbox = BoundingBox(Content=idealtablegeometry_2, Plane=xy)  # -> Box, Box_2
box_corners = BoxCorners(Box=bbox.Box)  # -> CornerA, CornerB, CornerC, CornerD, CornerE, CornerF, CornerG, CornerH
botlistensonport_4 = RemoteReceiver(botlistensonport)
item_6 = ListItem(List=panel_9, Index=filter_4, Wrap=True)
botip_4 = RemoteReceiver(botip)
multiplication = Multiplication(A=number_slider_7, B=number_slider_6)
previewlw_2 = CustomPreviewLineweights(
    Geometry=idealtablegeometry_2,
    Shader={ambient=RGB(0, 0, 0), diffuse=RGB(255, 105, 180), emission=RGB(76, 32, 54), shine=0.5, specular=RGB(255, 255, 255), transparency=0},
    Thickness=Slider(4, range=0..10),
    Absolute=False)
lower_right = Data(box_corners.CornerB)
upper_left = Data(box_corners.CornerD)
lower_left = Data(box_corners.CornerA)
upper_right = Data(box_corners.CornerC)
concat = Concatenate(FragmentA=panel_8, FragmentB=item_6)
fonts = FontTable()
# send it
udp_5 = UDPSender(Address=botip_4, Port=botlistensonport_4, Pattern=0, Data=item_5)  # disabled
pt = ConstructPoint(XCoordinate=number_slider_7, YCoordinate=number_slider_6, ZCoordinate=0)
jitter = Jitter(List=fonts, Jitter=1, Seed=multiplication)  # -> Values, Indices
filter_5 = StreamFilter(Gate=equals.Inequality, Stream1=concat)
merge_2 = Merge(Data1=lower_right, Data2=lower_left, Data3=upper_left, Data4=upper_right)
number_slider_8 = Slider(185, range=-50..550)
swatch = ColourSwatch(SwatchColor=RGB(196, 18, 255))
panel_10 = Panel(udp_5)  # disabled
number_slider_9 = Slider(65, range=-50..150)
item_7 = ListItem(List=jitter.Values, Index=0, Wrap=True)
panel_11 = Panel("""Tracker
Controller 1""")
cir = Circle(Plane=merge_2, Radius=Slider(5, range=0..10))
texttoscreen = RenderTextToScreen(Text=filter_5, Location=pt, Size=Slider(31, range=0..100), Color=swatch, Font=item_7, m_scWithvp=False)
panel_12 = Panel(panel_9)
boundary = BoundarySurfaces(Edges=cir)
multiplication_2 = Multiplication(A=number_slider_9, B=number_slider_8)
item_8 = ListItem(List=boundary, Index=filter_4, Wrap=True)
fonts_2 = FontTable()
pt_2 = ConstructPoint(XCoordinate=number_slider_9, YCoordinate=number_slider_8, ZCoordinate=0)
jitter_2 = Jitter(List=fonts_2, Jitter=1, Seed=multiplication_2)  # -> Values, Indices
panel_13 = Panel("""NOT
TRACKING!""")
preview = CustomPreview(Geometry=item_8, Shader=swatch)
swatch_2 = ColourSwatch(SwatchColor=RGB(255, 18, 18))
item_9 = ListItem(List=jitter_2.Values, Index=0, Wrap=True)
idealtablegeometry_3 = RemoteReceiver(idealtablegeometry)
idealtablegeometry_4 = RemoteReceiver(idealtablegeometry)

# ---- group: filter data for prexitisting
data = Data(split)
txt = Text("controller_1_POSE")
tmatch = MatchText(Text=data, RegEx=txt, Case=True)

# ----
dispatch_2 = Dispatch(List=data, DispatchPattern=tmatch)  # -> ListA, ListB

# ---- group: filter data for prexitisting (continued)
split_2 = TextSplit(Text=dispatch_2.ListA, Separators=" ")
item_10 = ListItem(List=reverse(split_2), Index=0, Wrap=True)
split_3 = TextSplit(Text=item_10, Separators=",")

# ----
rawcontroller1data = RemoteSender(split_3)
rawcontroller1data_2 = RemoteReceiver(rawcontroller1data)
ma = MassAddition(Input=rawcontroller1data_2)  # -> Result, PartialResults
rawcontroller1data_3 = RemoteReceiver(rawcontroller1data)
item_11 = ListItem(List=rawcontroller1data_3, Index=0, Wrap=True)  # -> Item, Item1, Item2, Item3, Item4, Item5, Item6, Item7
pt_3 = ConstructPoint(XCoordinate=item_11.Item, YCoordinate=item_11.Item2, ZCoordinate=item_11.Item1)
rawcontroller1pt = RemoteSender(pt_3)
rawcontroller1pt_2 = RemoteReceiver(rawcontroller1pt)

# ---- group: filter data for prexitisting
data_2 = Data(split)
txt_2 = Text("tracker_1_POSE")
tmatch_2 = MatchText(Text=data_2, RegEx=txt_2, Case=True)

# ----
dispatch_3 = Dispatch(List=data_2, DispatchPattern=tmatch_2)  # -> ListA, ListB

# ---- group: filter data for prexitisting (continued)
split_4 = TextSplit(Text=dispatch_3.ListA, Separators=" ")
item_12 = ListItem(List=reverse(split_4), Index=0, Wrap=True)
split_5 = TextSplit(Text=item_12, Separators=",")

# ----
rawtrackerdata = RemoteSender(split_5)
panel_14 = Panel(rawtrackerdata)
rawtrackerdata_2 = RemoteReceiver(rawtrackerdata)
item_13 = ListItem(List=rawtrackerdata_2, Index=0, Wrap=True)  # -> Item, Item1, Item2, Item3, Item4, Item5, Item6, Item7
rawrot = Data(item_13.Item4)
rawtrackerdata_3 = RemoteReceiver(rawtrackerdata)
pt_4 = ConstructPoint(XCoordinate=item_13.Item, YCoordinate=item_13.Item2, ZCoordinate=item_13.Item1)
rawpt = Geometry(pt_4)
gate = StreamGate(Stream=rawpt, Gate=filter_4)  # -> flatten(Target0), flatten(Target1), flatten(Target2), flatten(Target3)
ma_2 = MassAddition(Input=rawtrackerdata_3)  # -> Result, PartialResults
rec = DataRecorder(gate.Target0, DataLimit=1, RecordData=True)
rec_2 = DataRecorder(gate.Target1, DataLimit=1, RecordData=True)
rec_3 = DataRecorder(gate.Target2, DataLimit=1, RecordData=True)
rec_4 = DataRecorder(gate.Target3, DataLimit=1, RecordData=True)
merge_3 = Merge(Data1=ma_2.Result, Data2=ma.Result)
data_3 = Data(rec_4)
data_4 = Data(rec_3)
data_5 = Data(rec_2)
data_6 = Data(rec)
mm = MassMultiplication(Input=merge_3)  # -> Result, PartialResults
panel_15 = Panel(data_4)
panel_16 = Panel(data_3)
panel_17 = Panel(data_6)
panel_18 = Panel(data_5)
equals_2 = Equality(FirstNumber=mm.Result, SecondNumber=0)  # -> Equality, Inequality
equals_3 = Equality(FirstNumber=merge_3, SecondNumber=0)  # -> Equality, Inequality
vec2pt_2 = Vector2Pt(PointA=data_5, PointB=data_6, Unitize=False)  # -> Vector, Length
vec2pt_3 = Vector2Pt(PointA=data_5, PointB=data_4, Unitize=False)  # -> Vector, Length
dispatch_4 = Dispatch(List=panel_11, DispatchPattern=equals_3.Equality)  # -> ListA, ListB
counter_4 = Counter(CountDirection=True, Step=1, StartStop=equals_2.Equality, Reset=False)
vive_y_axis = Panel(vec2pt_3.Vector)
vive_x_axis = Panel(vec2pt_2.Vector)
random = Random(Range=Domain(0, 1), Number=1, Seed=counter_4)
item_14 = ListItem(List=jitter_2.Values, Index=counter_4, Wrap=True)
panel_19 = Panel(dispatch_4.ListA)
gradient = Gradient(
    LowerLimit=0,
    UpperLimit=1,
    Parameter=random,
    stops=[0: RGB(243, 57, 0), 0.1: RGB(236, 27, 60), 0.2: RGB(210, 0, 118), 0.3: RGB(103, 0, 120), 0.4: RGB(39, 72, 161), 0.5: RGB(1, 192, 229), 0.6: RGB(18, 178, 90), 0.7: RGB(79, 186, 8), 0.8: RGB(220, 237, 32), 0.9: RGB(247, 159, 20), 1: RGB(243, 57, 0)])
merge_4 = Merge(Data1=data_5, Data2=data_6, Data3=data_3, Data4=data_4)
pline_2 = PolyLine(Vertices=merge_4, Closed=True)
concat_2 = Concatenate(FragmentA=panel_19, FragmentB=panel_13)
rawcalibrationdata = RemoteSender(pline_2)
filter_6 = StreamFilter(Gate=equals_2.Equality, Stream1=concat_2)
join = TextJoin(Text=filter_6)
texttoscreen_2 = RenderTextToScreen(Text=join, Location=pt_2, Size=Slider(67, range=0..100), Color=gradient, Font=item_14, m_scWithvp=False)
# THE TUNNEL OF CALIBRATING GEOMETRY
rawtrackerdata_4 = RemoteReceiver(rawtrackerdata)
item_15 = ListItem(List=rawtrackerdata_4, Index=0, Wrap=True)  # -> Item, Item1, Item2, Item3, Item4, Item5, Item6, Item7
pt_5 = ConstructPoint(XCoordinate=item_15.Item, YCoordinate=item_15.Item2, ZCoordinate=item_15.Item1)
rawtrackerpt = RemoteSender(pt_5)
rawtrackerpt_2 = RemoteReceiver(rawtrackerpt)
rawcalibrationdata_2 = RemoteReceiver(rawcalibrationdata)
rawcalibrationdata_3 = RemoteReceiver(rawcalibrationdata)
recmap = RectangleMapping(Geometry=rawtrackerpt_2, Source=rawcalibrationdata_2, Target=idealtablegeometry_3)  # -> Geometry, Transform
recmap_2 = RectangleMapping(Geometry=rawcontroller1pt_2, Source=rawcalibrationdata_3, Target=idealtablegeometry_4)  # -> Geometry, Transform
calibratedtrackerpoint = RemoteSender(recmap.Geometry)
calibratedcontroller1pt = RemoteSender(recmap_2.Geometry)
calibratedcontroller1pt_2 = RemoteReceiver(calibratedcontroller1pt)
# THE PLAINS OF DISPLAYING
calibratedtrackerpoint_2 = RemoteReceiver(calibratedtrackerpoint)
rawtrackerdata_5 = RemoteReceiver(rawtrackerdata)  # disabled
rec_5 = DataRecorder(calibratedtrackerpoint_2, DataLimit=100, RecordData=True)
rec_6 = DataRecorder(calibratedcontroller1pt_2, DataLimit=100, RecordData=True)
shift_2 = ShiftList(List=rec_5, Shift=1, Wrap=False)
shift_3 = ShiftList(List=rec_6, Shift=1, Wrap=False)
item_16 = ListItem(List=rawtrackerdata_5, Index=0, Wrap=True)  # -> Item, Item1, Item2, Item3, Item4, Item5, Item6, Item7; disabled
short_2 = ShortestList(ListA=rec_5, ListB=shift_2, TrimMode=2)  # -> ListA, ListB
calibratedtrackerpoint_3 = RemoteReceiver(calibratedtrackerpoint)  # disabled

geothatsymbolizestracker_3 = RemoteReceiver(geothatsymbolizestracker)  # disabled
X_2 = UnitX(Factor=1)  # disabled
Z = UnitZ(Factor=1)  # disabled
rawrot_2 = Data(item_16.Item4)  # disabled
X_3 = UnitX(Factor=1)  # disabled
rad = Radians(Degrees=rawrot_2)  # disabled
volume_2 = Volume(Geometry=geothatsymbolizestracker_3)  # -> Volume, Centroid; disabled
vrot = Rotate(Vector=X_2, Axis=Z, Angle=rad)  # disabled
vdis_3 = VectorDisplay(Anchor=calibratedtrackerpoint_3, Vector=vrot)  # disabled
rotate = Rotate(Angle=1.570796327, Plane=PlaneXY(0, 0, 0))  # -> Geometry, Transform; disabled
orient_2 = OrientDirection(
    Geometry=geothatsymbolizestracker_3,
    PointA=volume_2.Centroid,
    DirectionA=X_3,
    PointB=calibratedtrackerpoint_3,
    DirectionB=Vector(0, 0, 1))  # -> Geometry, Transform; disabled

short_3 = ShortestList(ListA=rec_6, ListB=shift_3, TrimMode=2)  # -> ListA, ListB
ln = Line(StartPoint=short_2.ListA, EndPoint=short_2.ListB)
lng = ListLength(List=ln)
series = Series(Start=0, Step=1, Count=lng)
gradient_2 = Gradient(
    LowerLimit=0,
    UpperLimit=lng,
    Parameter=series,
    stops=[0: RGB(243, 57, 0), 0.1: RGB(236, 27, 60), 0.2: RGB(210, 0, 118), 0.3: RGB(103, 0, 120), 0.4: RGB(39, 72, 161), 0.5: RGB(1, 192, 229), 0.6: RGB(18, 178, 90), 0.7: RGB(79, 186, 8), 0.8: RGB(220, 237, 32), 0.9: RGB(247, 159, 20), 1: RGB(243, 57, 0)])
ln_2 = Line(StartPoint=short_3.ListA, EndPoint=short_3.ListB)
lng_2 = ListLength(List=ln_2)
series_2 = Series(Start=0, Step=1, Count=lng_2)
gradient_3 = Gradient(
    LowerLimit=0,
    UpperLimit=lng_2,
    Parameter=series_2,
    stops=[0: RGB(243, 57, 0), 0.1: RGB(236, 27, 60), 0.2: RGB(210, 0, 118), 0.3: RGB(103, 0, 120), 0.4: RGB(39, 72, 161), 0.5: RGB(1, 192, 229), 0.6: RGB(18, 178, 90), 0.7: RGB(79, 186, 8), 0.8: RGB(220, 237, 32), 0.9: RGB(247, 159, 20), 1: RGB(243, 57, 0)])
previewlw_3 = CustomPreviewLineweights(Geometry=ln, Shader=gradient_2, Thickness=Slider(25, range=0..100), Absolute=False)
previewlw_4 = CustomPreviewLineweights(Geometry=ln_2, Shader=gradient_3, Thickness=Slider(25, range=0..100), Absolute=False)

# ==== cluster SigFigRounding
A = ClusterInput()
x = ClusterInput()
_10º = PowerOf10(Value=x)
multiplication = Multiplication(A=A, B=_10º)
round = Round(Number=multiplication)  # -> Nearest, Floor, Ceiling
division = Division(A=round.Nearest, B=_10º)
R = ClusterOutput(division)

# ==== cluster SigFigRounding_2
x = ClusterInput()
A = ClusterInput()
_10º = PowerOf10(Value=x)
multiplication = Multiplication(A=A, B=_10º)
round = Round(Number=multiplication)  # -> Nearest, Floor, Ceiling
division = Division(A=round.Nearest, B=_10º)
R = ClusterOutput(division)

# ==== cluster Median
K = ClusterInput()
sort = SortList(Keys=K)  # -> Keys, ValuesA
lng = ListLength(List=sort.Keys)
division = Division(A=lng, B="2")
item = ListItem(List=sort.Keys, Index=division, Wrap=True)
i = ClusterOutput(item)
